# Grasshopper definition GH component block out.gh (Grasshopper 0.9.72)

# ---- group: Basic Material
c_script = CSharpScript()  # -> MatName, Material

# ----
mesh = Mesh()

# ---- group: Geometry
c_script_2 = CSharpScript(Meshes=mesh, Object_Material=c_script.MatName)

# ----
path = FilePath()

# ---- group: Scene Compiler
c_script_3 = CSharpScript(Write=Toggle(False), FilePath=path, Geometry=c_script_2, Materials=c_script.Material)
