# Grasshopper definition coloredMeshes_vA3Ctester_001.gh (Grasshopper 0.9.75)
# plug-ins: MeshEdit Components, GHva3c

srf = Surface(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)  # disabled
number_slider = Slider(26, range=1..100)  # disabled
number_slider_2 = Slider(3, range=3..20)  # disabled
srf_2 = Surface(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)
number_slider_3 = Slider(20, range=3..20)
scale = Scale(Geometry=srf, Center=Point(0, 0, 0), Factor=number_slider)  # -> Geometry, Transform; disabled
scale_2 = Scale(Geometry=srf_2, Center=Point(0, 0, 0), Factor=Slider(26, range=1..100))  # -> Geometry, Transform
mesh_uv = MeshSurface(Surface=scale.Geometry, UCount=number_slider_2, VCount=number_slider_2, Overhang=True, Equalize=False)  # disabled
mesh_uv_2 = MeshSurface(Surface=scale_2.Geometry, UCount=number_slider_3, VCount=number_slider_3, Overhang=True, Equalize=False)
demesh = DeconstructMesh(Mesh=mesh_uv)  # -> Vertices, Faces, Colours, Normals; disabled
explode = MeshExplode(Mesh=mesh_uv_2, Interpolate=False)
pdecon = Deconstruct(Point=demesh.Vertices)  # -> XComponent, YComponent, ZComponent; disabled
area = MeshArea(Mesh=explode)  # -> Area, Centroid
bnd = Bounds(Numbers=pdecon.ZComponent)  # disabled
pdecon_2 = Deconstruct(Point=area.Centroid)  # -> XComponent, YComponent, ZComponent
bnd_2 = Bounds(Numbers=pdecon_2.ZComponent)
remap = RemapNumbers(Value=pdecon.ZComponent, Source=bnd, Target=Domain(0, 1))  # -> Mapped, Clipped; disabled
c_script = CSharpScript()  # -> Out, A; disabled
panel = Panel("C:\Users\BHowes\Desktop\va3cColoredMeshFaces_test009.json")
panel_2 = Panel("C:\Users\BHowes\Documents\GitHub\WebProjects\CultureShedDaylighting\js\va3cColoredMeshFaces_test001.json")
remap_2 = RemapNumbers(Value=pdecon_2.ZComponent, Source=bnd_2, Target=Domain(0, 1))  # -> Mapped, Clipped
gradient = Gradient(
    LowerLimit=0,
    UpperLimit=1,
    Parameter=remap.Mapped,
    stops=[0: RGB(0, 98, 0), 0.25: RGB(81, 175, 17), 0.5: RGB(159, 198, 146), 0.75: RGB(170, 235, 41), 1: RGB(221, 255, 53)])  # disabled
swatch = ColourSwatch(SwatchColor=RGB(255, 29, 255))
swatch_2 = ColourSwatch(SwatchColor=RGB(0, 0, 255))
gradient_2 = Gradient(LowerLimit=0, UpperLimit=1, Parameter=remap_2.Mapped, stops=[0.662: RGB(255, 130, 160), 1: RGB(220, 0, 40)])
conmesh = ConstructMesh(Vertices=demesh.Vertices, Faces=demesh.Faces, Colours=gradient)  # disabled
va3c_meshcoloredfaces = Va3c_MeshColoredFaces(Mesh=mesh_uv_2, Colors=gradient_2)  # -> MeshJSON, MeshMaterialJSON
va3c_material = Va3c_Material(Color=ColourSwatch(SwatchColor=RGB(255, 255, 255)))
preview = CustomPreview(Geometry=explode, Shader=gradient_2)
panel_3 = Panel("C:\Users\BHowes\Documents\GitHub\WebProjects\CultureShedDaylighting\js\va3cColoredMeshFaces_test001.json")  # disabled
va3c_meshcoloredvertices = Va3c_MeshColoredVertices(Mesh=conmesh)  # -> MeshJSON, MeshMaterial; disabled
panel_4 = Panel(va3c_meshcoloredfaces.MeshJSON)
va3c_scenecompiler = Va3c_SceneCompiler(
    Write=Toggle(False),
    FilePath=panel_2,
    Meshes=va3c_meshcoloredfaces.MeshJSON,
    MeshMaterials=va3c_meshcoloredfaces.MeshMaterialJSON)  # -> Message, JsonPresentationOfScene
toggle = BooleanToggle(False)  # disabled
panel_5 = Panel(va3c_meshcoloredvertices.MeshMaterial)  # disabled
va3c_scenecompiler_2 = Va3c_SceneCompiler(
    Write=toggle,
    FilePath=panel_3,
    Meshes=va3c_meshcoloredvertices.MeshJSON,
    MeshMaterials=va3c_meshcoloredvertices.MeshMaterial)  # -> Message, JsonPresentationOfScene; disabled
