# Grasshopper definition line tester.gh (Grasshopper 0.9.75)
# plug-ins: GHva3c

crv = Curve([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])
scale = Scale(Geometry=crv, Center=Point(0, 0, 0), Factor=Slider(30, range=1..30))  # -> Geometry, Transform
dom = ConstructDomain(DomainStart=Slider(1, range=1..10), DomainEnd=Slider(6.5, range=1..10))
divide = DivideCurve(Curve=scale.Geometry, Count=Slider(100, range=1..100), Kinks=False)  # -> Points, Tangents, Parameters
bang = ExplodeTree(Data=divide.Points)  # -> Branch0, Branch1
ln = Line(StartPoint=bang.Branch0, EndPoint=bang.Branch1)
lng = ListLength(List=ln)
subtraction = Subtraction(A=lng, B="1")
range = Range(Domain=Domain(0, 1), Steps=subtraction)
remap = RemapNumbers(Value=range, Source=Domain(0, 1), Target=dom)  # -> Mapped, Clipped
gradient = Gradient(LowerLimit=0, UpperLimit=1, Parameter=range, stops=[0: RGB(0, 128, 0), 0.5: RGB(255, 255, 0), 1: RGB(255, 0, 0)])
va3c_line = Va3c_Line(Line=ln)
va3c_linebasicmaterial = Va3c_LineBasicMaterial(Color=gradient, LineWeight=remap.Mapped)
preview = CustomPreview(Geometry=ln, Shader=gradient)
va3c_scenecompiler = Va3c_SceneCompiler(
    Write=Toggle(False),
    FilePath="C:\Users\BHowes\Desktop\va3cLinesTester_008.json",
    Lines=va3c_line,
    LineMaterials=va3c_linebasicmaterial)  # -> Message, JsonPresentationOfScene
panel = Panel(va3c_scenecompiler.JsonPresentationOfScene)
