# Grasshopper definition mesh and line tester.gh (Grasshopper 0.9.75)
# plug-ins: GHva3c, LunchBox

number_slider = Slider(1801, range=0..10000)
srf = Surface(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)
number_slider_2 = Slider(16, range=3..20)
scale = Scale(Geometry=srf, Center=Point(0, 0, 0), Factor=Slider(81, range=1..100))  # -> Geometry, Transform
klein = KleinSurface(
    UDivisions=96,
    VDivisions=91,
    RParameter=3,
    TParameter=0.5,
    Scale=number_slider,
    Domain1=Domain(0, 12.56637061),
    Domain2=Domain(0, 3.141592654))
multiplication = Multiplication(A=number_slider, B=Slider(1.5, range=1..3))
panel = Panel("""Jonatan
Charlie
Ben""")
panel_2 = Panel("""true
1123
3.142""")
Z = UnitZ(Factor=multiplication)
mesh_uv = MeshSurface(Surface=scale.Geometry, UCount=number_slider_2, VCount=number_slider_2, Overhang=True, Equalize=False)
move = Move(Geometry=klein, Motion=Z)  # -> Geometry, Transform
demesh = DeconstructMesh(Mesh=mesh_uv)  # -> Vertices, Faces, Colours, Normals
mesh_uv_2 = MeshSurface(Surface=move.Geometry, UCount=Slider(15, range=0..100), VCount=Slider(9, range=0..100), Overhang=True, Equalize=False)
pdecon = Deconstruct(Point=demesh.Vertices)  # -> XComponent, YComponent, ZComponent
bnd = Bounds(Numbers=pdecon.ZComponent)
va3c_mesh = Va3c_Mesh(Mesh=mesh_uv_2, AttributeNames=panel, AttributeValues=panel_2)
va3c_material = Va3c_Material(Color=ColourSwatch(SwatchColor=RGB(129, 131, 135)))
remap = RemapNumbers(Value=pdecon.ZComponent, Source=bnd, Target=Domain(0, 1))  # -> Mapped, Clipped
crv = Curve([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])
gradient = Gradient(
    LowerLimit=0,
    UpperLimit=1,
    Parameter=remap.Mapped,
    stops=[0: RGB(0, 98, 0), 0.25: RGB(81, 175, 17), 0.5: RGB(159, 198, 146), 0.75: RGB(170, 235, 41), 1: RGB(221, 255, 53)])
scale_2 = Scale(Geometry=crv, Center=Point(0, 0, 0), Factor=Slider(30, range=1..30))  # -> Geometry, Transform
dom = ConstructDomain(DomainStart=Slider(1, range=1..10), DomainEnd=Slider(6.5, range=1..10))
divide = DivideCurve(Curve=scale_2.Geometry, Count=Slider(100, range=1..100), Kinks=False)  # -> Points, Tangents, Parameters
conmesh = ConstructMesh(Vertices=demesh.Vertices, Faces=demesh.Faces, Colours=gradient)
bang = ExplodeTree(Data=divide.Points)  # -> Branch0, Branch1
ln = Line(StartPoint=bang.Branch0, EndPoint=bang.Branch1)
lng = ListLength(List=ln)
subtraction = Subtraction(A=lng, B="1")
range = Range(Domain=Domain(0, 1), Steps=subtraction)
remap_2 = RemapNumbers(Value=range, Source=Domain(0, 1), Target=dom)  # -> Mapped, Clipped
gradient_2 = Gradient(LowerLimit=0, UpperLimit=1, Parameter=range, stops=[0: RGB(0, 128, 0), 0.5: RGB(255, 255, 0), 1: RGB(255, 0, 0)])
tri = Triangulate(Mesh=conmesh)  # -> Mesh, Count
va3c_linebasicmaterial = Va3c_LineBasicMaterial(Color=gradient_2, LineWeight=remap_2.Mapped)
va3c_line = Va3c_Line(Line=ln)
va3c_mesh_2 = Va3c_Mesh(Mesh=tri.Mesh)
va3c_material_2 = Va3c_Material(Color=ColourSwatch(SwatchColor=RGB(255, 0, 135)))
va3c_scenecompiler = Va3c_SceneCompiler(
    Write=Toggle(False),
    FilePath="C:\Users\bhowes\Desktop\TestMeshesAndLines.json",
    Meshes=flatten([va3c_mesh, va3c_mesh_2]),
    MeshMaterials=flatten([va3c_material, va3c_material_2]),
    Lines=flatten(va3c_line),
    LineMaterials=flatten(va3c_linebasicmaterial))  # -> Message, JsonPresentationOfScene
preview = CustomPreview(Geometry=ln, Shader=gradient_2)
panel_3 = Panel(va3c_scenecompiler.Message)
