# Grasshopper definition mesh tester 2.gh (Grasshopper 0.9.75)
# plug-ins: GHva3c, LunchBox

number_slider = Slider(1801, range=0..10000)
srf = Surface(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)
number_slider_2 = Slider(16, range=3..20)
scale = Scale(Geometry=srf, Center=Point(0, 0, 0), Factor=Slider(81, range=1..100))  # -> Geometry, Transform
multiplication = Multiplication(A=number_slider, B=Slider(1.5, range=1..3))
klein = KleinSurface(
    UDivisions=96,
    VDivisions=91,
    RParameter=3,
    TParameter=0.5,
    Scale=number_slider,
    Domain1=Domain(0, 12.56637061),
    Domain2=Domain(0, 3.141592654))
panel = Panel("""Jonatan
Charlie
Ben""")
panel_2 = Panel("""true
1123
3.142""")
Z = UnitZ(Factor=multiplication)
mesh_uv = MeshSurface(Surface=scale.Geometry, UCount=number_slider_2, VCount=number_slider_2, Overhang=True, Equalize=False)
move = Move(Geometry=klein, Motion=Z)  # -> Geometry, Transform
demesh = DeconstructMesh(Mesh=mesh_uv)  # -> Vertices, Faces, Colours, Normals
mesh_uv_2 = MeshSurface(Surface=move.Geometry, UCount=Slider(15, range=0..100), VCount=Slider(9, range=0..100), Overhang=True, Equalize=False)
pdecon = Deconstruct(Point=demesh.Vertices)  # -> XComponent, YComponent, ZComponent
bnd = Bounds(Numbers=pdecon.ZComponent)
va3c_geometry = Va3c_geometry(Mesh=mesh_uv_2, AttributeNames=panel, AttributeValues=panel_2)
creatematerial = CreateMaterial(Color=ColourSwatch(SwatchColor=RGB(129, 131, 135)))
remap = RemapNumbers(Value=pdecon.ZComponent, Source=bnd, Target=Domain(0, 1))  # -> Mapped, Clipped
gradient = Gradient(
    LowerLimit=0,
    UpperLimit=1,
    Parameter=remap.Mapped,
    stops=[0: RGB(0, 98, 0), 0.25: RGB(81, 175, 17), 0.5: RGB(159, 198, 146), 0.75: RGB(170, 235, 41), 1: RGB(221, 255, 53)])
conmesh = ConstructMesh(Vertices=demesh.Vertices, Faces=demesh.Faces, Colours=gradient)
tri = Triangulate(Mesh=conmesh)  # -> Mesh, Count
va3c_geometry_2 = Va3c_geometry(Mesh=tri.Mesh)
creatematerial_2 = CreateMaterial(Color=ColourSwatch(SwatchColor=RGB(255, 0, 135)))
va3c_scenecompiler = Va3c_SceneCompiler(
    Write=Toggle(True),
    FilePath="C:\Users\bhowes\Desktop\DrCyanKlein.json",
    Meshes=flatten([va3c_geometry, va3c_geometry_2]),
    MeshMaterials=flatten([creatematerial, creatematerial_2]))  # -> Message, JsonPresentationOfScene
panel_3 = Panel(va3c_scenecompiler.Message)
