# Grasshopper definition mesh tester.gh (Grasshopper 0.9.72)
# plug-ins: MeshEdit Components, GHva3c

series = Series(Start=0, Step=1, Count=10)
msphere = MeshSphere(Base=PlaneXY(0, 0, 0), Radius=series, UCount=3, VCount=3)
creatematerial = CreateMaterial(Color=ColourSwatch(SwatchColor=RGB(255, 255, 255)))  # -> Material, MaterialNames
triangulate = MeshTriangulate(Mesh=msphere, ShortDiagonal=True)
va3c_geometry = Va3c_geometry(Mesh=triangulate)
va3c_scene = Va3c_Scene(MeshGeo=va3c_geometry, Materials=creatematerial.Material)
panel = Panel(va3c_scene)
